# Dynamo graph Corridor Barrier Setout - SW.dyn (Dynamo 2.5.2.7915)
# packages: Civil3DToolkit 1.1.19

# group: Usage metric collection
code_block = CodeBlock { "Corridor Barrier Setout"; "0.1.0"; }
usageMetrics = Custom[UsageMetrics](scriptName=code_block.out0, scriptVersion=code_block.out1)  # Tracks run information an uploads to Power BI Database

# group: Get Corridor Feature Lines
corridor_name = CorridorNameDropDown("Corridor")  # graph input
corridor_barrier_code = StringInput("Back_Curb")  # graph input
corridorFeatureLinesByCode = Custom[CorridorFeatureLinesByCode](corridor=corridor_name, code=corridor_barrier_code)  # Returns all corridor feature lines for a given code

# group: Set barrier draw layer
barrier_draw_layer = StringInput("Barrier")  # graph input

# group: Start Terminal Creation
startStation = Autodesk.Civil.DynamoNodes.CorridorFeatureLine.StartStation(corridorFeatureLine=corridorFeatureLinesByCode.CorridorFeatureLine)
start_terminal_offset = DoubleSlider(15, range=0..500 step 1)  # graph input
add = startStation + start_terminal_offset
start_terminal_block_name = StringInput("TL3_Terminal")  # graph input
start_terminal_rotation_angle = DoubleInput(0)  # graph input
placeBlocksAlongCorridorFeatureLine = Custom[PlaceBlocksAlongCorridorFeatureLine](corridorFeatureLine=corridorFeatureLinesByCode.CorridorFeatureLine, station=add, blockName=start_terminal_block_name, blockRotationAngle=start_terminal_rotation_angle, layer=barrier_draw_layer)  # frozen; Places specified blocks along corridor feature lines at given station locations

# group: Post Creation
startStation_2 = Autodesk.Civil.DynamoNodes.CorridorFeatureLine.StartStation(corridorFeatureLine=corridorFeatureLinesByCode.CorridorFeatureLine)
start_post_offset = DoubleSlider(15.5, range=0..500 step 1)  # graph input
add_2 = startStation_2 + start_post_offset
endStation = Autodesk.Civil.DynamoNodes.CorridorFeatureLine.EndStation(corridorFeatureLine=corridorFeatureLinesByCode.CorridorFeatureLine)
end_post_offset = DoubleSlider(15.5, range=0..500 step 1)  # graph input
# note: Add bool to equalise start end spacing
sub = endStation - end_post_offset
post_spacing = DoubleSlider(2, range=0..500 step 1)  # graph input
range = Range(start=add_2, end=sub, step=post_spacing)
post_block_name = StringInput("TL3_Post")  # graph input
post_rotation_angle = DoubleInput(0)  # graph input
placeBlocksAlongCorridorFeatureLine_2 = Custom[PlaceBlocksAlongCorridorFeatureLine](corridorFeatureLine=corridorFeatureLinesByCode.CorridorFeatureLine, station=range, blockName=post_block_name, blockRotationAngle=post_rotation_angle, layer=barrier_draw_layer)  # frozen

# group: End Terminal Creation
endStation_2 = Autodesk.Civil.DynamoNodes.CorridorFeatureLine.EndStation(corridorFeatureLine=corridorFeatureLinesByCode.CorridorFeatureLine)
end_terminal_offset = DoubleSlider(15, range=0..500 step 1)  # graph input
sub_2 = endStation_2 - end_terminal_offset
end_terminal_block_name = StringInput("TL3_Terminal")  # graph input
end_terminal_rotation_angle = DoubleInput(180)  # graph input
placeBlocksAlongCorridorFeatureLine_3 = Custom[PlaceBlocksAlongCorridorFeatureLine](corridorFeatureLine=corridorFeatureLinesByCode.CorridorFeatureLine, station=sub_2, blockName=end_terminal_block_name, blockRotationAngle=end_terminal_rotation_angle, layer=barrier_draw_layer)  # frozen

# group: Get lists of terminal and post objects
join = List.Join()  # unwired: list0, list1, list2
code_block_2 = CodeBlock { 2; }
flatten = List.Flatten(list=placeBlocksAlongCorridorFeatureLine.BlockReference, amt=code_block_2)
code_block_3 = CodeBlock { 1; }
chop = List.Chop(list=flatten, lengths=code_block_3)
code_block_4 = CodeBlock { 1; }
flatten_2 = List.Flatten(list=placeBlocksAlongCorridorFeatureLine_2.BlockReference, amt=code_block_4)
code_block_5 = CodeBlock { 2; }
flatten_3 = List.Flatten(list=placeBlocksAlongCorridorFeatureLine_3.BlockReference, amt=code_block_5)
code_block_6 = CodeBlock { 1; }
chop_2 = List.Chop(list=flatten_3, lengths=code_block_6)
combine = List.Combine(comb=join, list1=chop, list2=flatten_2, list3=chop_2)

# group: Place Barrier Elements
post_block_name_2 = StringInput("Wire_Rope_Barrier")  # graph input
placeBarrierBlocks = Custom[PlaceBarrierBlocks](blockReferencesToJoin=combine, blockName=post_block_name_2, drawLayer=barrier_draw_layer)

watch = Watch(endStation)
polyCurve = Autodesk.Civil.DynamoNodes.CorridorFeatureLine.PolyCurve(corridorFeatureLine=corridorFeatureLinesByCode.CorridorFeatureLine)
start_terminal_offset_2 = DoubleSlider(15.5, range=0..500 step 1)  # graph input
code_block_7 = CodeBlock(layer=barrier_draw_layer) { layer; }

# group: Polyline set out start terminal
post_block_name_3 = StringInput("TL3_Terminal")  # graph input
post_rotation_angle_2 = DoubleInput(0)  # graph input
placeBlocksAlongPolycurve = Custom[PlaceBlocksAlongPolycurve](polycurve=polyCurve, station=start_terminal_offset_2, blockName=post_block_name_3, blockRotationAngle=post_rotation_angle_2, layer=code_block_7)

length = Curve.Length(curve=polyCurve)
end_terminal_offset_2 = DoubleSlider(15.5, range=0..500 step 1)  # graph input
sub_3 = length - end_terminal_offset_2
post_spacing_2 = DoubleSlider(2, range=0..500 step 1)  # graph input

# group: Polyline set out posts
range_2 = Range(start=start_terminal_offset_2, end=sub_3, step=post_spacing_2)
# note: Equalise start and end posts
post_block_name_4 = StringInput("TL3_Post")  # graph input
post_rotation_angle_3 = DoubleInput(0)  # graph input
placeBlocksAlongPolycurve_2 = Custom[PlaceBlocksAlongPolycurve](polycurve=polyCurve, station=range_2, blockName=post_block_name_4, blockRotationAngle=post_rotation_angle_3, layer=code_block_7)

# group: Polyline set out end terminal
post_block_name_5 = StringInput("TL3_Terminal")  # graph input
post_rotation_angle_4 = DoubleInput(180)  # graph input
placeBlocksAlongPolycurve_3 = Custom[PlaceBlocksAlongPolycurve](polycurve=polyCurve, station=sub_3, blockName=post_block_name_5, blockRotationAngle=post_rotation_angle_4, layer=code_block_7)

# group: Get lists of terminal and post objects
join_2 = List.Join()  # unwired: list0, list1, list2
code_block_8 = CodeBlock(start_terminal=placeBlocksAlongPolycurve.BlockReference) { start_terminal; }
code_block_9 = CodeBlock { 2; }
flatten_4 = List.Flatten(list=code_block_8, amt=code_block_9)
code_block_10 = CodeBlock { 1; }
chop_3 = List.Chop(list=flatten_4, lengths=code_block_10)
code_block_11 = CodeBlock(posts=placeBlocksAlongPolycurve_2.BlockReference) { posts; }
code_block_12 = CodeBlock { 1; }
flatten_5 = List.Flatten(list=code_block_11, amt=code_block_12)
code_block_13 = CodeBlock(end_terminal=placeBlocksAlongPolycurve_3.BlockReference) { end_terminal; }
code_block_14 = CodeBlock { 2; }
flatten_6 = List.Flatten(list=code_block_13, amt=code_block_14)
code_block_15 = CodeBlock { 1; }
chop_4 = List.Chop(list=flatten_6, lengths=code_block_15)
combine_2 = List.Combine(comb=join_2, list1=chop_3, list2=flatten_5, list3=chop_4)

# group: Place Barrier Elements
post_block_name_6 = StringInput("Wire_Rope_Barrier")  # graph input
placeBarrierBlocks_2 = Custom[PlaceBarrierBlocks](blockReferencesToJoin=combine_2, blockName=post_block_name_6, drawLayer=barrier_draw_layer)
